# Grasshopper definition Tower.gh (Grasshopper 1.0.8)
# plug-ins: Wallacei, Wombat

query_model_objects = QueryModelObjects(Layer="02_Tower_Base", Locked=True, Hidden=True, AutoUpdateState=True)
crv = Curve(query_model_objects)
explode = Explode(Curve=crv, Recursive=True)  # -> Segments, Vertices
area = Area(Geometry=crv)  # -> Area, Centroid
item = ListItem(List=explode.Segments, Index=0, Wrap=True)
mp = Midpoint(Curve=item)
ln = Line(StartPoint=area.Centroid, EndPoint=mp)
pl = ConstructPlane(Origin=area.Centroid, XAxis=ln, YAxis=Vector(0, 1, 0))
wlc_domain_begining = Slider(20.5, range=15..30)
wlc_domain_end = Slider(22.6, range=15..30)
dom = ConstructDomain(DomainStart=expr("-x", wlc_domain_begining), DomainEnd=wlc_domain_begining)
dom_2 = ConstructDomain(DomainStart=expr("-x", wlc_domain_end), DomainEnd=wlc_domain_end)
rectangle = Rectangle(Plane=pl, XSize=dom, YSize=dom_2, Radius=0)  # -> Rectangle, Length

wlc_ftf_height = Slider(3.7, range=2.9..5)
wlc_floor_count = Slider(26, range=5..70)
wlc_tower_twist = Slider(0.1, range=0..5)

wlc_domain_start = Slider(0.783, range=0..1)
wlc_upper_width = Slider(0.574, range=0..1)
dom_3 = ConstructDomain(DomainStart=wlc_domain_start, DomainEnd=wlc_upper_width)

# ---- group: TYPOLOGY MIX
wlc_coef_1 = Slider(0.228, range=0..1)
wlc_coef_2 = Slider(0.076, range=0..1)
wlc_coef_3 = Slider(0.358, range=0..1)
wlc_coef_4 = Slider(0.071, range=0..1)

# ----
series = Series(Start=0, Step=wlc_ftf_height, Count=wlc_floor_count)
series_2 = Series(Start=0, Step=wlc_tower_twist, Count=wlc_floor_count)
Z = UnitZ(Factor=series)
move = Move(Geometry=rectangle.Rectangle, Motion=Z)  # -> Geometry, Transform
area_2 = Area(Geometry=move.Geometry)  # -> Area, Centroid
lng = ListLength(List=area_2.Centroid)
range = Range(Domain=Domain(0, 1), Steps=expr("x-1", lng))
tower_deflection = GraphMapper(
    range,
    x0=0,
    x1=1,
    y0=0,
    y1=1,
    container_name="Bezier",
    cpx=[0, 0.738173306, 0.605435133, 1],
    cpy=[0.2548726201, 0.008803665638, 0.06793481112, 1])
crv_2 = Curve(move.Geometry)
remap = RemapNumbers(Value=tower_deflection, Source=Domain(0, 1), Target=dom_3)  # -> Mapped, Clipped
scale = Scale(Geometry=crv_2, Center=area_2.Centroid, Factor=remap.Mapped)  # -> Geometry, Transform
num = Number(series_2)
rotate = Rotate(Geometry=scale.Geometry, Angle=degrees(num), Plane=area_2.Centroid)  # -> Geometry, Transform
boundary = BoundarySurfaces(Edges=rotate.Geometry)
Z_2 = UnitZ(Factor=wlc_ftf_height)
extr = Extrude(Base=boundary, Direction=Z_2)
cluster = Cluster(V=wlc_coef_1, L=extr)
cluster_2 = Cluster(V=wlc_coef_2, L=extr)
cluster_3 = Cluster(V=wlc_coef_3, L=extr)
cluster_4 = Cluster(V=wlc_coef_4, L=extr)
py3 = Python3Script(data=extr, i1=cluster, i2=cluster_2, i3=cluster_3, i4=cluster_4)  # -> out1, out2, out3, out4; inputs data: list
# ---------- py3: Python ----------
indices = sorted([int(i1), int(i2), int(i3)])

indices = [max(0, min(len(data), i)) for i in indices]


out1 = data[:indices[0]]
out2 = data[indices[0]:indices[1]]
out3 = data[indices[1]:indices[2]]
out4 = data[indices[2]:]
# ---------- end py3 ----------
colour_swatch = ColourSwatch(SwatchColor=RGB(181, 8, 255))  # disabled
colour_swatch_2 = ColourSwatch(SwatchColor=RGB(255, 222, 8))  # disabled
colour_swatch_3 = ColourSwatch(SwatchColor=RGB(255, 94, 8))  # disabled
colour_swatch_4 = ColourSwatch(SwatchColor=RGB(8, 94, 255))  # disabled
custom_preview = CustomPreview(Geometry=py3.out1, Material=colour_swatch_3)  # disabled
custom_preview_2 = CustomPreview(Geometry=py3.out2, Material=colour_swatch)  # disabled
custom_preview_3 = CustomPreview(Geometry=py3.out3, Material=colour_swatch_4)  # disabled
custom_preview_4 = CustomPreview(Geometry=py3.out4, Material=colour_swatch_2)  # disabled
data = Data(simplify(graft(extr)))
tstat = TreeStatistics(Tree=data)  # -> Paths, Length, Count
data_2 = Data(simplify(data))
debrep = DeconstructBrep(Brep=data_2)  # -> Faces, Edges, Vertices
panel = Panel("""Floor
Type
GFA
Facade Area""")
area_3 = Area(Geometry=debrep.Faces)  # -> Area, Centroid
pdecon = Deconstruct(Point=area_3.Centroid)  # -> XComponent, YComponent, ZComponent
join = TextJoin(Text=panel, Join="_")
lng_2 = ListLength(List=py3.out1)
lng_3 = ListLength(List=py3.out2)
lng_4 = ListLength(List=py3.out3)
lng_5 = ListLength(List=py3.out4)
sort = SortList(Keys=pdecon.ZComponent, ValuesA=debrep.Faces)  # -> Keys, ValuesA
dup = DuplicateData(Data=join, Number=tstat.Count, Order=True)  # -> graft(Data)
panel_2 = Panel("""0
-1""")
dup_2 = DuplicateData(Data="Retail", Number=lng_2, Order=True)
dup_3 = DuplicateData(Data="Office", Number=lng_3, Order=True)
dup_4 = DuplicateData(Data="Hospitality", Number=lng_4, Order=True)
dup_5 = DuplicateData(Data="Retai", Number=lng_5, Order=True)
item_2 = ListItem(List=sort.ValuesA, Index=0, Wrap=True)  # -> simplify(Item)
cull_i = CullIndex(List=sort.ValuesA, Indices=panel_2, Wrap=True)
tstat_2 = TreeStatistics(Tree=data_2)  # -> Paths, Length, Count
split = TextSplit(Text=dup, Separators="_")  # -> simplify(Result)
merge = Merge(Data1=dup_2, Data2=dup_3, Data3=dup_4, Data4=dup_5)  # -> graft(Result)
area_4 = Area(Geometry=cull_i)  # -> Area, Centroid
data_3 = Data(split)
series_3 = Series(Start=0, Step=1, Count=tstat_2.Count)  # -> graft(Series)
ma = MassAddition(Input=area_4.Area)  # -> simplify(Result), PartialResults
area_5 = Area(Geometry=item_2)  # -> Area, Centroid
int = Integer(area_5.Area)
int_2 = Integer(ma.Result)
merge_2 = Merge(Data1=simplify(series_3), Data2=simplify(merge), Data3=simplify(int), Data4=simplify(int_2))
ma_2 = MassAddition(Input=flatten(area_5.Area))  # -> Result, PartialResults
panel_3 = Panel(data_3)
panel_4 = Panel(merge_2)
panel_5 = Panel(ma_2.Result)
button = Button()
file_path = FilePath("C:\Users\RAIDER\OneDrive\Escritorio\data.json")
gene_pool_and_slider_shuffler = GenePoolAndSliderShuffler(BooleanButton=button)
python_3_script = Python3Script(keys=panel_3, values=panel_4, filePath=file_path, write=button)  # -> out, a, b, c; inputs keys: tree, values: tree
# ---------- python_3_script: Python ----------
import json
import os

result = []
status = ""

try:
    branch_count = min(keys.BranchCount, values.BranchCount)

    for i in range(branch_count):
        k_branch = list(keys.Branch(i))
        v_branch = list(values.Branch(i))

        row = {}
        item_count = min(len(k_branch), len(v_branch))

        for j in range(item_count):
            k = str(k_branch[j])
            v = v_branch[j]
            try:
                s = str(v)
                v = float(s) if "." in s else int(s)
            except:
                v = str(v)
            row[k] = v

        result.append(row)

    status = "OK - {} rows built".format(len(result))

except Exception as e:
    status = "ERROR: " + str(e)

# Always produce JSON text
jsonText = json.dumps(result, indent=2)

# Write file only when button pressed
path = str(filePath).strip()
if write and path:
    folder = os.path.dirname(path)
    if folder and not os.path.exists(folder):
        os.makedirs(folder)
    with open(path, "w", encoding="utf-8") as f:
        f.write(jsonText)
    status += " | Written to " + path

# outputs
a = jsonText
b = result
c = status
# ---------- end python_3_script ----------
boolean_toggle = BooleanToggle(True)
python_3_script_2 = Python3Script(jsonData=python_3_script.a, run=boolean_toggle)  # -> out, a
# ---------- python_3_script_2: Python ----------
import re, os, io, json, System
import Eto.Forms as ef
import Eto.Drawing as ed
import Rhino.UI
import scriptcontext as sc
import BaseHTTPServer
import threading

PORT = 9876

# ── Find HTML and state file ───────────────────────────────────
roots = [
    os.path.join(os.path.expanduser("~"), "OneDrive", "Escritorio"),
    os.path.join(os.path.expanduser("~"), "Desktop"),
    os.path.join(os.path.expanduser("~"), "OneDrive", "Desktop"),
]
html_path  = None
state_path = None
for r in roots:
    h = os.path.join(r, "rhino-dataviz-v2.html")
    if os.path.exists(h):
        html_path  = h
        state_path = os.path.join(r, "rhino_state.json")
        break

if not html_path:
    a = "ERROR: HTML not found"
elif not jsonData:
    a = "Waiting for data..."
else:
    try:
        json_str  = str(jsonData)
        rows      = json.loads(json_str)
        row_count = len(rows)

        # ── Inject live GH data into HTML ──────────────────────
        with open(html_path, "r", encoding="utf-8") as f:
            html = f.read()
        new_html = re.sub(
            r'(<script id="chart-data" type="application/json">).*?(</script>)',
            lambda m: m.group(1) + "\n" + json_str + "\n" + m.group(2),
            html, flags=re.DOTALL
        )

        # ── Shared HTML reference (updated without restarting server) ─
        if "dataviz_html_ref" not in sc.sticky:
            sc.sticky["dataviz_html_ref"] = [""]
        sc.sticky["dataviz_html_ref"][0] = new_html

        # ── Start HTTP server (only once) ───────────────────────
        def make_server(html_ref, sp, port):
            class H(BaseHTTPServer.BaseHTTPRequestHandler):
                def do_GET(self):
                    if self.path in ('/', '/index.html'):
                        data = html_ref[0].encode('utf-8')
                        self.send_response(200)
                        self.send_header('Content-Type', 'text/html; charset=utf-8')
                        self.send_header('Content-Length', str(len(data)))
                        self.end_headers()
                        self.wfile.write(data)
                    else:
                        self.send_response(404)
                        self.end_headers()

                def do_POST(self):
                    length = int(self.headers.getheader('Content-Length', 0))
                    body = self.rfile.read(length)
                    try:
                        msg = json.loads(body)
                        try:
                            with io.open(sp, 'r', encoding='utf-8') as f:
                                state = json.load(f)
                        except:
                            state = {'selected': [], 'colors': []}
                        t = msg.get('type', '')
                        d = msg.get('data')
                        if t == 'select':
                            state['selected'] = d
                        elif t == 'colors':
                            state['colors'] = d
                        with io.open(sp, 'w', encoding='utf-8') as f:
                            json.dump(state, f)
                        print("Written:", t, str(d)[:60])
                    except Exception as e:
                        print("POST error:", str(e))
                    self.send_response(200)
                    self.send_header('Access-Control-Allow-Origin', '*')
                    self.end_headers()
                    self.wfile.write(b'OK')

                def do_OPTIONS(self):
                    self.send_response(200)
                    self.send_header('Access-Control-Allow-Origin', '*')
                    self.send_header('Access-Control-Allow-Methods', 'POST, GET, OPTIONS')
                    self.send_header('Access-Control-Allow-Headers', 'Content-Type')
                    self.end_headers()

                def log_message(self, fmt, *args):
                    pass  # suppress HTTP logs

            srv = BaseHTTPServer.HTTPServer(('localhost', port), H)
            thr = threading.Thread(target=srv.serve_forever)
            thr.daemon = True
            thr.start()
            return srv

        # Only start the server once — reuse if already running
        existing_server = sc.sticky.get("dataviz_server")
        if existing_server is None:
            try:
                server = make_server(sc.sticky["dataviz_html_ref"], state_path, PORT)
                sc.sticky["dataviz_server"] = server
                server_msg = "HTTP server started on :{}.".format(PORT)
            except Exception as e:
                sc.sticky["dataviz_server"] = None
                server_msg = "Server error: " + str(e)
        else:
            server_msg = "HTTP server reused on :{}.".format(PORT)

        panel_url = System.Uri("http://localhost:{}/".format(PORT))

        # ── Open or refresh panel ───────────────────────────────
        existing_form = sc.sticky.get("dataviz_form",  None)
        existing_wv   = sc.sticky.get("dataviz_wv",    None)
        panel_alive   = (existing_form is not None and not existing_form.IsDisposed)

        if panel_alive:
            existing_wv.Url = panel_url
            a = "Refreshed — {} rows.\n{}".format(row_count, server_msg)
        else:
            form = ef.Form()
            form.Title     = "Data Viz"
            form.Resizable = True
            try:
                rw      = Rhino.UI.RhinoEtoApp.MainWindow
                panel_w = 430
                form.Size     = ed.Size(panel_w, rw.Height - 60)
                form.Location = ed.Point(rw.Location.X + rw.Width - panel_w, rw.Location.Y + 30)
            except:
                form.Size = ed.Size(430, 900)

            wv     = ef.WebView()
            wv.Url = panel_url
            form.Content = wv
            form.Show()
            form.BringToFront()

            sc.sticky["dataviz_form"] = form
            sc.sticky["dataviz_wv"]   = wv
            a = "Panel opened — {} rows.\n{}".format(row_count, server_msg)

        # ── Init state file if missing ──────────────────────────
        if not os.path.exists(state_path):
            with io.open(state_path, "w", encoding="utf-8") as f:
                json.dump({"selected": [], "colors": []}, f)

    except Exception as e:
        a = "Error: " + str(e)
# ---------- end python_3_script_2 ----------
panel_6 = Panel(python_3_script_2.a)
entwine = Entwine(Branch00=py3.out1, Branch01=py3.out2, Branch02=py3.out3, Branch03=py3.out4, FlattenInputs=True)
python_3_script_3 = Python3Script(run=boolean_toggle)  # -> out, selected_idx, graft(colors), status
# ---------- python_3_script_3: Python ----------
# ═══════════════════════════════════════════════════════════════
# GH STATE READER — reads rhino_state.json written by the viewer
#
# INPUTS:
#   trigger  → connect a GH Timer component (set to 0.5s interval)
#              to auto-poll, OR connect a Button to read on demand
#
# OUTPUTS:
#   selected_idx  → list of selected floor indices (integers)
#                   connect to a List Item filter on your geometry
#   colors        → list of System.Drawing.Color per palette slot
#                   connect to Custom Preview > Shader input
#   status        → status message (connect a Panel)
# ═══════════════════════════════════════════════════════════════

import json, os
import System.Drawing as sd

# ── Find state file ────────────────────────────────────────────
roots = [
    os.path.join(os.path.expanduser("~"), "OneDrive", "Escritorio"),
    os.path.join(os.path.expanduser("~"), "Desktop"),
    os.path.join(os.path.expanduser("~"), "OneDrive", "Desktop"),
]
state_path = None
for r in roots:
    p = os.path.join(r, "rhino_state.json")
    if os.path.exists(p):
        state_path = p
        break

if state_path is None:
    selected_idx = []
    colors       = []
    status       = "No rhino_state.json yet — interact with the panel first."
else:
    try:
        with open(state_path, "r", encoding="utf-8") as f:
            state = json.load(f)

        # ── Selected: extract floor index from name like "Retai_5" ──
        raw_sel = state.get("selected", [])
        selected_idx = []
        for name in raw_sel:
            try:
                idx = int(name.split("_")[-1])
                selected_idx.append(idx)
            except:
                pass

        # ── Colors: convert hex strings → System.Drawing.Color ──────
        hex_colors = state.get("colors", [])
        colors = []
        for hx in hex_colors:
            try:
                hx = hx.lstrip("#")
                r = int(hx[0:2], 16)
                g = int(hx[2:4], 16)
                b = int(hx[4:6], 16)
                colors.append(sd.Color.FromArgb(255, r, g, b))
            except:
                colors.append(sd.Color.Gray)

        status = "OK — {} selected, {} colors".format(len(selected_idx), len(colors))

    except Exception as e:
        selected_idx = []
        colors       = []
        status       = "Error reading state: " + str(e)
# ---------- end python_3_script_3 ----------
custom_preview_5 = CustomPreview(Geometry=entwine, Material=ColourSwatch(SwatchColor=RGB(110, 110, 110)))
panel_7 = Panel(python_3_script_3.status)
custom_preview_6 = CustomPreview(Geometry=entwine, Material=python_3_script_3.colors)
list_item = ListItem(List=flatten(entwine), Index=python_3_script_3.selected_idx, Wrap=True)
custom_preview_7 = CustomPreview(Geometry=list_item, Material=ColourSwatch(SwatchColor=RGB(255, 0, 255)))

# ==== cluster Cluster
L = ClusterInput()
lng = ListLength(List=L)
V = ClusterInput()
dom = ConstructDomain(DomainStart=0, DomainEnd=lng)
remap = RemapNumbers(Value=V, Source=Domain(0, 1), Target=dom)  # -> Mapped, Clipped
int = Integer(remap.Mapped)
int_2 = ClusterOutput(int)
